# Grasshopper definition SLI__CER.gh (Grasshopper 1.0.7)

mesh = Mesh(<mesh referenced from the Rhino model>)
bridge_slicer = BridgeSlicer(
    input_mesh=mesh,
    layer_height=0.25,
    twist_amount_0_1=0,
    layer_group_size=4,
    rel_min_holesize_0_1=0.2,
    rel_max_holesize_0_1=1,
    divisions=20,
    wall_thinkness_offset=0.15,
    wall_thinkness_layers=2)  # -> skirt_base_2, bridges_2
entwine = Entwine(Branch00=bridge_slicer.skirt_base_2, Branch01=bridge_slicer.bridges_2, FlattenInputs=True)

# ---- group: curves to print
crv = Curve(entwine)

# ----
curves_to_gcode = GCodeGenerator(input_curve_s=flatten(crv), feedspeed="1800", extruderfactor="25", retraction_amount="3", retraction_speed="2500")  # -> g_code_output_2, travel_lines_3

printing_settings = PrintingSettings(gcode=curves_to_gcode.g_code_output_2, extruder_temp="215", heatbed_temp="40", fan_speed=100)
panel = Panel(printing_settings)

# ==== cluster BridgeSlicer
wall_thinkness_layers = ClusterInput()
wall_thinkness_offset = ClusterInput()
input_mesh = ClusterInput()
divisions = ClusterInput()
rel_max_holesize_0_1 = ClusterInput()
twist_amount_0_1 = ClusterInput()
rel_min_holesize_0_1 = ClusterInput()
layer_height = ClusterInput()
wall_thinkness_layers_2 = Integer(wall_thinkness_layers)
wall_thinkness_offset_2 = Number(wall_thinkness_offset)
layer_group_size = ClusterInput()
divisions_2 = Integer(divisions)
wall_thinkness_layers_3 = Integer(wall_thinkness_layers_2)
rel_max_holesize_0_1_2 = Number(rel_max_holesize_0_1)
wall_thinkness_offset_3 = Number(wall_thinkness_offset_2)
rel_min_holesize_0_1_2 = Number(rel_min_holesize_0_1)
twist_amount_0_1_2 = Number(twist_amount_0_1)

# ---- group: # levels
layer_group_size_2 = Integer(layer_group_size)

# ---- group: selected mesh
# Bridging Slicer
input_mesh_2 = Mesh(input_mesh)

# ---- group: thickness offset layers
panel = Panel(wall_thinkness_layers_2)

# ----
layer_height_2 = Number(layer_height)

# ---- group: curves thickness offset amunt
panel_2 = Panel(wall_thinkness_offset_2)

# ---- group: # of segments in each ring
int = Integer(divisions_2)

# ----
pt = ConstructPoint(XCoordinate=0, YCoordinate="1000", ZCoordinate=0)

# ---- group: # levels
int_2 = Integer(layer_group_size_2)

# ---- group: curves thickness offset amunt
panel_3 = Panel(wall_thinkness_offset_3)

# ---- group: thickness offset layers
panel_4 = Panel(wall_thinkness_layers_3)

# ----
# 1. Test if mesh is colored. if not color the mesh black
demesh = DeconstructMesh(Mesh=input_mesh_2)  # -> Vertices, Faces, Colours, Normals
null = NullItem(Item=demesh.Colours)  # -> NullFlags, InvalidFlags, Description
filter = StreamFilter(Gate=null.NullFlags, Stream0=demesh.Colours, Stream1=ColourSwatch(SwatchColor=RGB(0, 0, 0)))
conmesh = ConstructMesh(Vertices=demesh.Vertices, Faces=demesh.Faces, Colours=filter)

# ---- group: level group caout calculation / # levels
int_3 = Integer(layer_group_size_2)

# ---- group: level group caout calculation
division = Division(A=int, B="2")
multiplication = Multiplication(A=division, B=int_3)

# ---- group: distant point ref
pt_2 = Point(pt)

# ----
# 6. change gap  openning based on mesh colors
panel_5 = Panel("0.2")
dom = ConstructDomain(DomainStart="0", DomainEnd=panel_5)
dom_2 = ConstructDomain(DomainStart="0", DomainEnd="0.2")
remap = RemapNumbers(Value=rel_min_holesize_0_1_2, Source=Domain(0, 1), Target=dom)  # -> Mapped, Clipped
remap_2 = RemapNumbers(Value=rel_max_holesize_0_1_2, Source=Domain(0, 1), Target=dom_2)  # -> Mapped, Clipped
neg = Negative(Value=remap.Mapped)
neg_2 = Negative(Value=remap_2.Mapped)
dom_3 = ConstructDomain(DomainStart=neg, DomainEnd=neg_2)

# ---- group: level group caout calculation / levelGroup count
int_4 = Integer(multiplication)

# ---- group: colored mesh
mesh = Mesh(conmesh)

mesh_2 = Mesh(mesh)

# ---- group: selected mesh
mesh_3 = Mesh(mesh_2)

# ---- group: holeSize relative domian
domain = Domain(dom_3)

domain_2 = Domain(domain)

# ---- group: # of offsets
number_slider = Slider(5, range=0..10)

# ----
rebcrv = RebuildCurve(EndTangents=False)

# ---- group: levelGroup count
int_5 = Integer(int_4)

# ---- group: layer height
num = Number(layer_height_2)

# ----
# 2. create contour curves & offsets
Z = UnitZ(Factor=1)
num_2 = Number(layer_height_2)
series = Series(Start=0, Step=panel_3, Count=panel_4)
contour = Contour(Shape=mesh_2, Point=Point(0, 0, 0), Direction=Z, Distance=num_2)

# ---- group: Contour curves
crv = Curve(flatten(contour))

# ----
offset_l = OffsetCurveLoose(Curve=graft(crv), Distance=series)
offset = OffsetCurve(Curve=graft(crv), Distance=series, Plane=PlaneXY(0, 0, 0), Corners=1)
trim = TrimTree(Tree=offset, Depth=1)

# ---- group: offsett contour curves
crv_2 = Curve(offset_l)

crv_3 = Curve(crv_2)

# ---- group: check if curves are closed
cls = Closed(Curve=crv_3)  # -> Closed, Periodic

# ---- group: open/closed curve pattern
bool = Boolean(cls.Closed)

bool_2 = Boolean(cls.Closed)

# ----
# 3. Split open and closd curves to two lists
dispatch = Dispatch(List=crv_3, DispatchPattern=bool_2)  # -> ListA, ListB

# ---- group: closed curves
crv_4 = Curve(dispatch.ListA)

crv_5 = Curve(crv_4)

# ---- group: open curves
crv_6 = Curve(dispatch.ListB)

crv_7 = Curve(crv_6)

# ----
# 3.2 Flip open curves anyotherone for continious printing
trim_2 = TrimTree(Tree=crv_7, Depth=1)
dispatch_2 = Dispatch(List=trim_2, DispatchPattern=[True, False])  # -> ListA, ListB
flip = FlipCurve(Curve=dispatch_2.ListB)  # -> Curve, Flag
weave = Weave(Pattern=[0, 1], Stream0=dispatch_2.ListA, Stream1=flip.Curve, NullGaps=False)

# ---- group: flipped open curves
crv_8 = Curve(weave)

crv_9 = Curve(crv_8)

# ----
# 7. create bridges
toggle = BooleanToggle(False)

# ----
# 4. weave open and closed curves to one list
trim_3 = TrimTree(Tree=bool, Depth=1)

# ----
# 3.1 align closed  curves and apply twist (if selected)
join = JoinCurves(Curves=crv_5, Preserve=False)
crv_cp = CurveClosestPoint(Point=pt_2, Curve=join)  # -> Point, Parameter, Distance
seam = Seam(Curve=join, Seam=crv_cp.Parameter)
trim_4 = TrimTree(Tree=seam, Depth="2")

# ---- group: aligned closed curves
crv_10 = Curve(trim_4)

crv_11 = Curve(reparameterize(crv_10))

# ----
lng = ListLength(List=crv_11)
division_2 = Division(A=twist_amount_0_1_2, B=lng)
series_2 = Series(Start=0, Step=division_2, Count=lng)
crv_12 = Curve(crv_11)
trim_5 = TrimTree(Tree=series_2, Depth=1)
eval = EvaluateLength(Curve=crv_12, Length=trim_5, Normalized=True)  # -> Point, Tangent, Parameter
seam_2 = Seam(Curve=crv_12, Seam=eval.Parameter)

# ---- group: aligned closed curves w/ twist
crv_13 = Curve(seam_2)

crv_14 = Curve(crv_13)

# ----
weave_2 = Weave(Pattern=trim_3, Stream0=crv_9, Stream1=crv_14, NullGaps=False)

# ---- group: slices
crv_15 = Curve(weave_2)

crv_16 = Curve(crv_15)

# ----
# 5. division to layer groups
panel_6 = Panel("1")
repeat = RepeatData(Data=panel_6, Length=int_2)
repeat_2 = RepeatData(Data="0", Length=int_2)
merge = Merge(Data1=repeat_2, Data2=repeat)
dispatch_3 = Dispatch(List=crv_16, DispatchPattern=merge)  # -> ListA, ListB

# ---- group: curve sets 1
crv_17 = Curve(dispatch_3.ListA)

crv_18 = Curve(reparameterize(crv_17))

# ---- group: curve set 2
crv_19 = Curve(dispatch_3.ListB)

crv_20 = Curve(reparameterize(crv_19))

# ----
cls_2 = Closed(Curve=crv_20)  # -> Closed, Periodic
divide = DivideCurve(Curve=crv_18, Count=int, Kinks=False)  # -> Points, Tangents, Parameters
divide_2 = DivideCurve(Curve=crv_20, Count=int, Kinks=False)  # -> Points, Tangents, Parameters
graft = GraftTree(Tree=cls_2.Closed, IncludeEmptyLists=True, IncludeNullItems=True)
shatter = Shatter(Curve=graft(crv_18), Parameters=divide.Parameters)
shatter_2 = Shatter(Curve=graft(crv_20), Parameters=divide_2.Parameters)
graft_2 = GraftTree(Tree=graft, IncludeEmptyLists=True, IncludeNullItems=True)
shift = ShiftList(List=shatter_2, Shift="1", Wrap=graft_2)
trim_6 = TrimTree(Tree=shift, Depth=1)
partition = PartitionList(List=shatter, Size="2")
partition_2 = PartitionList(List=trim_6, Size="2")
join_2 = JoinCurves(Curves=partition, Preserve=False)
join_3 = JoinCurves(Curves=partition_2, Preserve=False)
trim_7 = TrimTree(Tree=join_2, Depth="1")
trim_8 = TrimTree(Tree=join_3, Depth="1")
cluster = Cluster(mesh=mesh_3, crv=trim_7)
cluster_2 = Cluster(mesh=mesh_3, crv=trim_8)
len = Length(Curve=trim_8)
remap_3 = RemapNumbers(Value=cluster_2, Source=Domain(0, 1), Target=domain_2)  # -> Mapped, Clipped
remap_4 = RemapNumbers(Value=cluster, Source=Domain(0, 1), Target=domain_2)  # -> Mapped, Clipped
len_2 = Length(Curve=trim_7)
multiplication_2 = Multiplication(A=len_2, B=remap_4.Mapped)
multiplication_3 = Multiplication(A=remap_3.Mapped, B=len)
ext = ExtendCurve(Curve=trim_8, Type="1", Start=multiplication_3, End=multiplication_3)
ext_2 = ExtendCurve(Curve=trim_7, Type="1", Start=multiplication_2, End=multiplication_2)
trim_9 = TrimTree(Tree=ext, Depth="3")
trim_10 = TrimTree(Tree=ext_2, Depth="3")
partition_3 = PartitionList(List=trim_10, Size=int_5)
partition_4 = PartitionList(List=trim_9, Size=int_5)
merge_2 = Merge(Data1=partition_4, Data2=partition_3)

# ---- group: level pattern
bool_3 = Boolean(merge)

# ---- group: slices
crv_21 = Curve(crv_15)

# ---- group: select the first curve
item = ListItem(List=flatten(crv_21), Index="0", Wrap=True)

# ----
crv_22 = Curve(item)
reb = RebuildCurve(Curve=item, Count="20", Tangents=False)

# ---- group: create skirts offsets
series_3 = Series(Start=0, Step=num, Count=number_slider)
offset_2 = OffsetCurve(Curve=reb, Distance=series_3, Plane=PlaneXY(0, 0, 0), Corners=1)  # -> flatten(Curve)

# ----
offset_l_2 = OffsetCurveLoose(Curve=reb, Distance=series_3)

# ---- group: Bridges
crv_23 = Curve(merge_2)

# ---- group: preview
preview = CustomPreview(Geometry=crv_23, Material=ColourSwatch(SwatchColor=RGB(50, 166, 255)))

# ---- group: test if the first curve is open or closed
cls_3 = Closed(Curve=item)  # -> Closed, Periodic

# ----
# 8. skirt/base
dispatch_4 = Dispatch(List=offset_2, DispatchPattern=[True, False])  # -> ListA, ListB
flip_2 = FlipCurve(Curve=dispatch_4.ListB)  # -> Curve, Flag
weave_3 = Weave(Pattern=[0, 1], Stream0=dispatch_4.ListA, Stream1=flip_2.Curve, NullGaps=False)
filter_2 = StreamFilter(Gate=cls_3.Closed, Stream0=weave_3, Stream1=offset_2)

bridges = Curve(crv_23)
bridges_2 = ClusterOutput(bridges)
skirt_base = Curve(filter_2)
skirt_base_2 = ClusterOutput(skirt_base)

# ==== cluster GCodeGenerator

# ---- group: input curves
input_curve_s = ClusterInput()
input_curve_s_2 = Curve(input_curve_s)

# ---- group: feed
feedspeed = ClusterInput()
feedspeed_2 = Integer(feedspeed)

# ---- group: extruder factor
extruderfactor = ClusterInput()
extruderfactor_2 = Number(extruderfactor)

# ----
retraction_amount = ClusterInput()
retraction_amount_2 = Number(retraction_amount)

retraction_speed = ClusterInput()
retraction_speed_2 = Integer(retraction_speed)

# ---- group: retraction speed
panel = Panel(retraction_speed_2)

# ---- group: retraction amount
panel_2 = Panel(retraction_amount_2)

# ---- group: curves to print
crv = Curve(input_curve_s_2)

# ---- group: retraction amount
num = Number(panel_2)

# ---- group: curve middle / extrusion factor
num_2 = Number(extruderfactor_2)

# ---- group: convert to polyline
topoly = CurveToPolyline(
    Curve=crv,
    ToleranceDistance=Slider(0.4, range=0..1),
    ToleranceAngle=degrees(Slider(91, range=0..100)),
    MinEdge="3",
    MaxEdge="50")  # -> Polyline, Segments

# ---- group: polyline
crv_2 = Curve(topoly.Polyline)

crv_3 = Curve(crv_2)

# ---- group: shatter into segments
cpoly = ControlPolygon(Curve=crv_3)  # -> Polygon, Points
crv_cp = CurveClosestPoint(Point=cpoly.Points, Curve=graft(crv_3))  # -> Point, Parameter, Distance
num_3 = Number(crv_cp.Parameter)
shatter = Shatter(Curve=graft(crv_3), Parameters=num_3)

# ---- group: shatter into segments / gcode points
pt = Point(crv_cp.Point)

# ---- group: gcode points
pt_2 = Point(pt)

pt_3 = Point(pt)

pt_4 = Point(pt)

# ---- group: curve end / last point
lng = ListLength(List=pt_4)
subtraction = Subtraction(A=lng, B="1")
item = ListItem(List=pt_4, Index=subtraction, Wrap=True)

# ---- group: curve start
item_2 = ListItem(List=pt_2, Index="0", Wrap=True)
panel_3 = Panel(panel_2)
concat = Concatenate(FragmentA=" F1800 E", FragmentB=panel_3)
pdecon = Deconstruct(Point=item_2)  # -> XComponent, YComponent, ZComponent
cluster = Cluster_2(N=pdecon.XComponent)
cluster_2 = Cluster_2(N=pdecon.YComponent)
cluster_3 = Cluster_2(N=pdecon.ZComponent)
concat_2 = Concatenate(
    FragmentA="G1 X",
    FragmentB=cluster,
    FragmentC=" Y",
    FragmentD=cluster_2,
    FragmentE=" Z",
    FragmentF=cluster_3,
    FragmentI=" F8000")  # -> simplify(Result)
concat_3 = Concatenate(FragmentA="G1 Z", FragmentB=pdecon.ZComponent, FragmentC=concat)  # -> simplify(Result)

# ---- group: curve end / retraction speed
num_4 = Number(panel)

# ---- group: generate Rapid lines
crv_4 = Curve(input_curve_s_2)
end = EndPoints(Curve=crv_4)  # -> Start, End
shift = ShiftList(List=end.Start, Shift=1, Wrap=False)
ln = Line(StartPoint=end.End, EndPoint=shift)

# ---- group: curve middle / feed speed
int = Integer(feedspeed_2)

# ---- group: curve segments
crv_5 = Curve(shatter)

crv_6 = Curve(crv_5)

# ---- group: curve middle
trim = TrimTree(Tree=crv_6, Depth="1")
cull_i = CullIndex(List=pt_3, Indices="0", Wrap=True)
len = Length(Curve=trim)
ma = MassAddition(Input=len)  # -> Result, PartialResults
pt_5 = Point(cull_i)
trim_2 = TrimTree(Tree=pt_5, Depth=1)
division = Division(A=ma.PartialResults, B=num_2)
addition = Addition(A=division, B=num)
pdecon_2 = Deconstruct(Point=trim_2)  # -> XComponent, YComponent, ZComponent
lng_2 = ListLength(List=addition)
cluster_4 = Cluster_2(N=pdecon_2.XComponent)
cluster_5 = Cluster_2(N=pdecon_2.YComponent)
cluster_6 = Cluster_2(N=pdecon_2.ZComponent)
cluster_7 = Cluster_2(N=addition)
subtraction_2 = Subtraction(A=lng_2, B="1")
item_3 = ListItem(List=addition, Index=subtraction_2, Wrap=True)
subtraction_3 = Subtraction(A=item_3, B=num)
concat_4 = Concatenate(
    FragmentA="G1 X",
    FragmentB=cluster_4,
    FragmentC=" Y",
    FragmentD=cluster_5,
    FragmentE=" Z",
    FragmentF=cluster_6,
    FragmentG=" E",
    FragmentH=cluster_7,
    FragmentI=" F",
    FragmentJ=int)  # -> simplify(Result)

# ---- group: curve end
pdecon_3 = Deconstruct(Point=item)  # -> XComponent, YComponent, ZComponent
cluster_8 = Cluster_2(N=subtraction_3)
concat_5 = Concatenate(FragmentA="G1 F", FragmentD=num_4, FragmentC=" E", FragmentB=cluster_8)
concat_6 = Concatenate(FragmentE=concat_5, FragmentA="G1 Z", FragmentB=pdecon_3.ZComponent, FragmentC=" F3300", FragmentD="G92 E0")  # -> simplify(Result)

# ----
travel_lines = Text(ln)

# ---- group: last point on curve gcode
txt = Text(concat_6)

# ---- group: first point off a curve gcode
txt_2 = Text(concat_2)

# ---- group: curve start
txt_3 = Text(concat_3)

# ---- group: first point off a curve gcode
txt_4 = Text(txt_2)

# ---- group: last point on curve gcode
txt_5 = Text(txt)

# ---- group: curve start
txt_6 = Text(txt_3)

# ----
merge = Merge(Data1=txt_4, Data2=txt_6, Data3=concat_4, Data4=txt_5)
g_code_output = Text(merge)
travel_lines_2 = Text(travel_lines)
g_code_output_2 = ClusterOutput(g_code_output)
travel_lines_3 = ClusterOutput(travel_lines_2)

# ==== cluster PrintingSettings
extruder_temp = ClusterInput()
gcode = ClusterInput()
heatbed_temp = ClusterInput()
fan_speed = ClusterInput()

# ---- group: fan Speed
fan_speed_2 = Number(fan_speed)

# ----
gcode_2 = Text(gcode)
concat = Concatenate(FragmentA="M 106 ", FragmentB=fan_speed_2)
equals = Equality(FirstNumber=fan_speed_2, SecondNumber="0")  # -> Equality, Inequality
heatbed_temp_2 = Integer(heatbed_temp)
extruder_temp_2 = Integer(extruder_temp)
filter = StreamFilter(Gate=equals.Equality, Stream0=concat, Stream1="M 107 ")
concat_2 = Concatenate(FragmentA="M109 S", FragmentB=extruder_temp_2)
concat_3 = Concatenate(FragmentA="M190 S", FragmentB=heatbed_temp_2)
panel = Panel(filter)
panel_2 = Panel(concat_2)
panel_3 = Panel(concat_3)
panel_4 = Panel("""G21        ;metric values
G90        ;absolute positioning
M107       ;start with the fan off
G28 X0 Y0  ;move X/Y to min endstops""")
panel_5 = Panel("""G92 E0     ;zero the extruded length
G1 F200 E3 ;extrude 3mm of feed stock
G92 E0     ;zero the extruded length again
G1 F3000

G28 Z0     
G1 Z15.0 F3000 """)
panel_6 = Panel("""M104 S0           ;extruder heater off
M140 S0          ;heated bed heater off 
G91              ;relative positioning
G1 E-1 F300     ;retract the filament 
G1 Z+0.5 E-5 X-20 Y-20 F3000 
G28 X0 Y0                              
M84            ;steppers off
G90            ;absolute positioning""")
merge = Merge(
    Data1=panel_2,
    Data2="T0",
    Data3=panel_3,
    Data4=panel_4,
    Data5=panel,
    Data6=panel_5,
    Data7=flatten(gcode_2),
    Data8=panel_6)
full_gcode = Text(merge)
full_gcode_2 = ClusterOutput(full_gcode)

# ==== cluster Cluster
# evalute mesh color on the mid point of the curve
mesh = ClusterInput()
crv = ClusterInput()
crv_2 = Curve(crv)
curvepoint = PointOnCurve(crv_2, parameter=0.5)
mesh_2 = Mesh(mesh)
meshcp = MeshClosestPoint(Point=curvepoint, Mesh=mesh_2)  # -> Point, Index, Parameter
meval = MeshEval(Mesh=mesh_2, Parameter=meshcp.Parameter)  # -> Point, Normal, Colour
ahsl = SplitAHSL(Colour=meval.Colour)  # -> Alpha, Hue, Saturation, Luminance
brnts = Number(ahsl.Luminance)
brnts_2 = ClusterOutput(brnts)

# ==== cluster Cluster_2
N = ClusterInput()
N_2 = Number(N)
multiplication = Multiplication(A=N_2, B="100")
round = Round(Number=multiplication)  # -> Nearest, Floor, Ceiling
division = Division(A=round.Nearest, B="100")
N_3 = Number(division)
N_4 = ClusterOutput(N_3)
